# Grasshopper definition Resuest Buildings from FEMA.gh (Grasshopper 1.0.7)
# plug-ins: Swiftlet

# ----
# East Midtown
panel = Panel("-84.3824, 33.770, -84.3676, 33.7824")

# ----
# English Avenue
panel_2 = Panel("-84.4187, 33.7627, -84.4030, 33.7737")

# ----
# Georgia Tech Campus
panel_3 = Panel("-84.4085, 33.7702, -84.3882, 33.7825")

# ----
# WGS BBox Coordinates
xmin = Slider(-84.3824, range=-100..100)
ymin = Slider(33.77, range=-100..100)
xmax = Slider(-84.3676, range=-100..100)
ymax = Slider(33.7824, range=-100..100)

split = TextSplit(Text=panel, Separators=",")
num = Number(split)
item = ListItem(List=num, Index=0, Wrap=True)  # -> Item, Item1, Item2, Item3
xmin_2 = Number(item.Item)
ymin_2 = Number(item.Item1)
xmax_2 = Number(item.Item2)
ymax_2 = Number(item.Item3)
xmin_3 = Number(xmin_2)
ymin_3 = Number(ymin_2)
xmax_3 = Number(xmax_2)
ymax_3 = Number(ymax_2)
panel_4 = Panel("https://services2.arcgis.com/FiaPA4ga0iQKduv3/ArcGIS/rest/services/USA_Structures_View/FeatureServer/0/query")
xmax_4 = Number(xmax_2)
ymax_4 = Number(ymax_2)
xmin_4 = Number(xmin_2)
ymin_4 = Number(ymin_2)
concat = Concatenate(
    FragmentA="{\"xmin\": ",
    FragmentB=xmin_4,
    FragmentC=",\"ymin\": ",
    FragmentD=ymin_4,
    FragmentE=",\"xmax\": ",
    FragmentF=xmax_4,
    FragmentG=",\"ymax\": ",
    FragmentH=ymax_4,
    FragmentI=",\"spatialReference\": {\"wkid\": 4326}}")
cqp = CreateQueryParam(Key="outSR", Value="{\"wkid\": 6350}")
cqp_2 = CreateQueryParam(Key="f", Value="pjson")
data = Data([null x19])
cqp_3 = CreateQueryParam(Key="geometry", Value=concat)
merge = Merge(Data1=data, Data2=cqp_3, Data3=cqp, Data4=cqp_2)  # -> flatten(Result)
get = GETRequest(URL=panel_4, Params=merge)  # -> Status, Content, Response
pjs = ParseJSONString(Text=get.Content)
rjo = ReadJSONObject(JObject=pjs)  # -> Keys, JTokens
gjok = GetJSONObjectKey(JObject=pjs, Key="features")
rja = ReadJSONArray(Array=gjok)
gjok_2 = GetJSONObjectKey(JObject=rja, Key="geometry")
gjok_3 = GetJSONObjectKey(JObject=rja, Key="attributes")
gjok_4 = GetJSONObjectKey(JObject=gjok_2, Key="rings")
rja_2 = ReadJSONArray(Array=gjok_4)
gjok_5 = GetJSONObjectKey(JObject=gjok_3, Key="HEIGHT")
rja_3 = ReadJSONArray(Array=rja_2)
rja_4 = ReadJSONArray(Array=rja_3)
rjv = ReadJSONValue(JValue=gjok_5)  # -> AsString, AsNumber, AsBool
rjv_2 = ReadJSONValue(JValue=rja_4)  # -> AsString, AsNumber, AsBool
item_2 = ListItem(List=rjv_2.AsString, Index=0, Wrap=True)  # -> Item, Item1
num_2 = Number(rjv.AsString)
pt = ConstructPoint(XCoordinate=item_2.Item, YCoordinate=item_2.Item1, ZCoordinate=0)
trim = TrimTree(Tree=pt, Depth=1)
pline = PolyLine(Vertices=trim, Closed=invert(False))
Z = UnitZ(Factor=num_2)  # -> graft(UnitVector)
trim_2 = TrimTree(Tree=pline, Depth=1)  # -> simplify(Tree)
boundary = BoundarySurfaces(Edges=trim_2)
extr = Extrude(Base=boundary, Direction=Z)
